# Dynamo graph Material.dyn (Dynamo 2.0.4.12684)

# group: All
all = Orchid.RevitMaterial.Material.All()
name = Material.Name(material=all)
watch = Watch(name)
watch_2 = Watch(all)

# group: Class/Category
material = Material(index=1)  # graph input
getCategory = Orchid.RevitMaterial.Material.GetCategory(material=material)
watch_3 = Watch(getCategory)
getClass = Orchid.RevitMaterial.Material.GetClass(material=material)
watch_4 = Watch(getClass)

# group: Asset
material_2 = Material(index=1)  # graph input
asset = Orchid.RevitMaterial.Material.Asset(material=material_2)
watch_5 = Watch(asset.Appearance)
watch_6 = Watch(asset.Physical)
watch_7 = Watch(asset.Thermal)

# group: Asset Parameter
material_3 = Material(index=1)  # graph input
assetParameter = Orchid.RevitMaterial.Material.AssetParameter(material=material_3)
watch_8 = Watch(assetParameter.Appearance)
watch_9 = Watch(assetParameter.Physical)
watch_10 = Watch(assetParameter.Thermal)

# group: Parameter
material_4 = Material(index=1)  # graph input
parameter = Orchid.RevitMaterial.Material.Parameter(material=material_4)
watch_11 = Watch(parameter)

# group: Asset
material_5 = Material(index=1)  # graph input
appearanceAsset = Orchid.RevitMaterial.Material.AppearanceAsset(material=material_5)
watch_12 = Watch(appearanceAsset)
physicalAsset = Orchid.RevitMaterial.Material.PhysicalAsset(material=material_5)
watch_13 = Watch(physicalAsset)
thermalAsset = Orchid.RevitMaterial.Material.ThermalAsset(material=material_5)
watch_14 = Watch(thermalAsset)
